# Grasshopper definition MOO-test-visualize-bars.gh (Grasshopper 0.9.76)
# plug-ins: Writer, MOO, Sift

number_slider = Slider(8.023, range=0..10)
number_slider_2 = Slider(0.106, range=0..10)
expression = Expression(x=number_slider, Expression="10-x^(1/2)")
number_of_variables = Slider(2, range=0..10)
change_index = Slider(3, range=0..100)
addition = Addition(A=number_slider, B=number_slider_2)
moo = MOO(
    Variables=[number_slider, number_slider_2],
    Objectives=[addition, expression],
    PopulationSize=Slider(20, range=0..100),
    Generations=Slider(10, range=0..100),
    Seed=Slider(0, range=0..100),
    Filename="MOO-test-1.csv",
    Directory="C:\temp\")  # -> ParetoFront, AllSolutions
split = SplitList(List=moo.AllSolutions, Index=number_of_variables)  # -> ListA, ListB
# Copy panels or
# write file to graph
# in other software
panel = Panel("pareto")
# Reconstruct Design
sift = Sift(Variables=[number_slider, number_slider_2], DesignMap=split.ListA, Index=change_index)
panel_2 = Panel(moo.ParetoFront)
concat = Concatenate(FragmentA="C:\temp\", FragmentB=panel)
split_2 = SplitList(List=moo.ParetoFront, Index=number_of_variables)  # -> ListA, ListB
current_design = Panel(sift)
item = ListItem(List=panel_2, Index=2, Wrap=True)  # -> flatten(Item)
objective_1_pareto_values = Panel(item)
item_2 = ListItem(List=panel_2, Index=3, Wrap=True)  # -> flatten(Item)
objective_2_pareto_values = Panel(item_2)
writer = Writer(Data=split_2.ListB, Filepath=concat)
item_3 = ListItem(List=flatten(item), Index=change_index, Wrap=True)
item_4 = ListItem(List=flatten(item_2), Index=change_index, Wrap=True)
# Quick Visualization
graph = QuickGraph(item_2)
graph_2 = QuickGraph(item)
# Rhino Visualization
# of Objective Space
# Pareto Front Designs
pt = ConstructPoint(XCoordinate=item, YCoordinate=0, ZCoordinate=item_2)
# Current Design
pt_2 = ConstructPoint(XCoordinate=item_3, YCoordinate=0, ZCoordinate=item_4)
units = Panel("")
units_2 = Panel("")
num = Number(item_3)
expression_2 = Expression(x=num, Expression="Format(\"{0:0.0}\", x)")  # -> flatten(R)

x_bar = Slider(6, range=0..500)
z_bar = Slider(1.512, range=0..5)
scale_bar = Slider(0.39, range=0..1)
x_overall = Slider(0, range=0..100)
z_overall = Slider(1, range=0..100)
neg = Negative(Value=z_bar)
division = Division(A=item_3, B=scale_bar)
vec = VectorXYZ(XComponent=x_bar, YComponent=0, ZComponent=neg)  # -> Vector, Length
addition_2 = Addition(A=x_bar, B=division)
neg_2 = Negative(Value=z_overall)
text_size = Panel("1")
dom = ConstructDomain(DomainStart=x_bar, DomainEnd=addition_2)
pt_3 = ConstructPoint(XCoordinate=x_overall, YCoordinate=0, ZCoordinate=neg_2)
move = Move(Geometry=pt_3, Motion=vec.Vector)  # -> Geometry, Transform
dom_2 = ConstructDomain(DomainStart=0, DomainEnd=text_size)
expression_3 = Expression(x="Objective 1: ", y=expression_2, z=units, Expression="Format(\"{0:0.00}\", x & y & z)")
xz = XZPlane(Origin=move.Geometry)
X = UnitX(Factor=1)
rectangle = Rectangle(Plane=xz, XSize=dom, YSize=dom_2, Radius=0)  # -> Rectangle, Length
Z = UnitZ(Factor=-1.5)
xz_2 = XZPlane(Origin=pt_3)
boundary = BoundarySurfaces(Edges=rectangle.Rectangle)
addition_3 = Addition(A=Z, B=X)
move_2 = Move(Geometry=xz_2, Motion=addition_3)  # -> Geometry, Transform
preview = CustomPreview(Geometry=boundary, Shader=ColourSwatch(SwatchColor=RGB(0, 170, 255)))
rgb = ColourRGB(Alpha=255, Red=0, Green=0, Blue=0)
tag = TextTag3D(Location=move_2.Geometry, Text=expression_3, Size=text_size, Colour=rgb, Justification=7)

num_2 = Number(item_4)
expression_4 = Expression(x=num_2, Expression="Format(\"{0:0.0}\", x)")  # -> flatten(R)

x_bar_2 = Slider(6, range=0..500)
z_bar_2 = Slider(1.512, range=0..5)
scale_bar_2 = Slider(0.39, range=0..1)
x_overall_2 = Slider(0, range=0..100)
z_overall_2 = Slider(3, range=0..100)
neg_3 = Negative(Value=z_bar_2)
division_2 = Division(A=item_4, B=scale_bar_2)
vec_2 = VectorXYZ(XComponent=x_bar_2, YComponent=0, ZComponent=neg_3)  # -> Vector, Length
addition_4 = Addition(A=x_bar_2, B=division_2)
neg_4 = Negative(Value=z_overall_2)
text_size_2 = Panel("1")
dom_3 = ConstructDomain(DomainStart=x_bar_2, DomainEnd=addition_4)
pt_4 = ConstructPoint(XCoordinate=x_overall_2, YCoordinate=0, ZCoordinate=neg_4)
move_3 = Move(Geometry=pt_4, Motion=vec_2.Vector)  # -> Geometry, Transform
dom_4 = ConstructDomain(DomainStart=0, DomainEnd=text_size_2)
expression_5 = Expression(x="Objective 2: ", y=expression_4, z=units_2, Expression="Format(\"{0:0.00}\", x & y & z)")
xz_3 = XZPlane(Origin=move_3.Geometry)
X_2 = UnitX(Factor=1)
rectangle_2 = Rectangle(Plane=xz_3, XSize=dom_3, YSize=dom_4, Radius=0)  # -> Rectangle, Length
Z_2 = UnitZ(Factor=-1.5)
xz_4 = XZPlane(Origin=pt_4)
boundary_2 = BoundarySurfaces(Edges=rectangle_2.Rectangle)
addition_5 = Addition(A=Z_2, B=X_2)
move_4 = Move(Geometry=xz_4, Motion=addition_5)  # -> Geometry, Transform
preview_2 = CustomPreview(Geometry=boundary_2, Shader=ColourSwatch(SwatchColor=RGB(255, 0, 255)))
rgb_2 = ColourRGB(Alpha=255, Red=0, Green=0, Blue=0)
tag_2 = TextTag3D(Location=move_4.Geometry, Text=expression_5, Size=text_size_2, Colour=rgb_2, Justification=7)
