# Grasshopper definition cluster-test.gh (Grasshopper 0.9.76)
# plug-ins: Cluster, MOO, Sampler

number_slider = Slider(0.768, range=0..3)
number_slider_2 = Slider(0.077, range=0..3)
number_slider_3 = Slider(0.151, range=0..3)
ma = MassAddition(Input=[number_slider_3, number_slider_2, number_slider])  # -> Result, PartialResults
sampler = Sampler(Variables=[number_slider_3, number_slider_2, number_slider], Samples="100", Type=0, Seed="0", Directory="None")  # -> DesignMap, Data
moo = MOO(
    Variables=[number_slider_3, number_slider_2, number_slider],
    Objectives=ma.Result,
    PopulationSize=Slider(20, range=0..100),
    Generations=Slider(10, range=0..1000),
    Seed=Slider(1, range=0..1),
    Filename="test-01.csv",
    Directory="C:\temp")  # -> ParetoFront, AllSolutions
panel = Panel(sampler.DesignMap)
sampler_data = Data(panel)
moo_data = Data(moo.AllSolutions)
rectangle = Rectangle(Plane=PlaneXY(0, 0, 0), XSize=number_slider_3, YSize=number_slider_2, Radius=0)  # -> Rectangle, Length
boxrec = BoxRectangle(Rectangle=rectangle.Rectangle, Height=number_slider)
cluster = Cluster(
    Variables=[number_slider_3, number_slider_2, number_slider],
    DesignMap=moo_data,
    NumberOfClusters=Slider(3, range=0..10),
    Flexibility=Slider(0.249, range=0..1),
    ClusterIndex=Slider(0, range=0..3),
    Run=Button())  # -> ClusterList, ClusterAvs, ClusterMins, ClusterMaxs, ClusterObjs
panel_2 = Panel(cluster.ClusterList)
panel_3 = Panel(cluster.ClusterObjs)
