# Grasshopper definition diversity-test.gh (Grasshopper 0.9.76)
# plug-ins: Sampler, Diversity

# ----
# Generate Points
panel = Panel("3")
sampler = Sampler(Variables=[Slider(4, range=1..10), Slider(4, range=1..10)], Samples="1000", Type=0, Seed=panel, Directory="None")  # -> DesignMap, Data

item = ListItem(List=sampler.DesignMap, Index=0, Wrap=True)
# Calculate "Objectives"
item_2 = ListItem(List=sampler.DesignMap, Index=1, Wrap=True)
addition = Addition(A=item, B=item_2)

obj_target_2_x_value = Slider(5, range=0..10)
obj_thresh_2 = Slider(0.72, range=0..1)

obj_target_1_addition = Slider(11, range=0..100)
obj_thresh_1 = Slider(0.3, range=0..1)
# 1. Cull for proximity to objective
# 2. Cull to diverse, representative set
number_slider = Slider(1000, range=0..10000)
diversity = Diversity(
    DesignMap=sampler.DesignMap,
    Mode=0,
    ObjectiveScores=[addition, item],
    ObjectiveTargets=[obj_target_1_addition, obj_target_2_x_value],
    ObjectiveThreshold=[obj_thresh_1, obj_thresh_2],
    CullTo=Slider(10, range=0..10),
    Iterations=number_slider,
    Run=Toggle(True))  # -> DiversityOfAllQualified, QualifiedIndices, QualifiedSet, DiversityOfCulled, CulledIndices, CulledSet
diversity_of_culled_set = Panel(diversity.DiversityOfCulled)
diversity_of_qualified_set = Panel(diversity.DiversityOfAllQualified)

# ----
# Diverse Set
# Qualified Points
# Pareto Front
# Visualize Results
cullpareto = CSharpScript(data=diversity.QualifiedSet)  # -> out, opt, nonopt; inputs data: tree of Double
# ---------- cullpareto: C# ----------
    // NOTE: Thanks to James Ramsden for this Pareto Culling code!
    // http://james-ramsden.com/grasshopper-calculate-the-pareto-front-in-multi-objective-data-in-c/

    DataTree<double> optimal = new DataTree<double>();
    DataTree<double> nonoptimal = new DataTree<double>();

    //data should be a tree, where each branch is equivalent to one data point, and the length of the list is equal to the number of parameters.
    for(int n = 0; n < data.BranchCount; n++) //for each node
    {
      //check it against every other node
      //we need to find one node where every parameter is superior. if not, we have pareto optimality
      bool superiornodefound = false;
      for (int i = 0; i < data.BranchCount; i++) //check node i
      {
        bool issuperior = true;
        for(int p = 0; p < data.Branch(0).Count; p++)
        {
          if(data.Branch(i)[p] > data.Branch(n)[p])
          {
            issuperior = false;
            break;
          }
        }
        if(issuperior && i != n) superiornodefound = true;
      }
      if(superiornodefound) nonoptimal.AddRange(data.Branch(n), new GH_Path(nonoptimal.BranchCount));
      else optimal.AddRange(data.Branch(n), new GH_Path(optimal.BranchCount));
    }

    //return outputs
    opt = optimal;
    nonopt = nonoptimal;

    //grasshopper-related UI
    double optimalratio = Math.Round(100.0 * optimal.BranchCount / data.BranchCount, 1);
    Component.Message = optimalratio.ToString() + "% optimal";
    Component.Description = optimalratio.ToString() + "% of solutions are Pareto optimal.";
# ---------- end cullpareto ----------
flip = FlipMatrix(Data=diversity.CulledSet)
flip_2 = FlipMatrix(Data=cullpareto.opt)
flip_3 = FlipMatrix(Data=diversity.QualifiedSet)
bang = ExplodeTree(Data=flip)  # -> Branch0, Branch1
bang_2 = ExplodeTree(Data=flip_2)  # -> Branch0, Branch1
bang_3 = ExplodeTree(Data=flip_3)  # -> Branch0, Branch1
pt = ConstructPoint(XCoordinate=bang.Branch0, YCoordinate=bang.Branch1, ZCoordinate=0)
sort = SortList(Keys=bang_2.Branch0, ValuesA=bang_2.Branch1)  # -> Keys, ValuesA
pt_2 = ConstructPoint(XCoordinate=bang_3.Branch0, YCoordinate=bang_3.Branch1, ZCoordinate=0)
circle = CircleCNR(Center=pt, Normal=Vector(0, 0, 1), Radius=0.15)
pt_3 = ConstructPoint(XCoordinate=sort.Keys, YCoordinate=sort.ValuesA, ZCoordinate=0)
circle_2 = CircleCNR(Center=pt_2, Normal=Vector(0, 0, 1), Radius=0.06)
brep = Brep(circle)
pline = PolyLine(Vertices=pt_3, Closed=False)
brep_2 = Brep(circle_2)
preview = CustomPreview(Geometry=brep, Shader=ColourSwatch(SwatchColor=RGB(0, 0, 0)))
preview_2 = CustomPreview(Geometry=brep_2, Shader=ColourSwatch(SwatchColor=RGB(0, 174, 255)))
pipe = Pipe(Curve=pline, Radius=0.03, Caps=0)
