# Grasshopper definition logger-test.gh (Grasshopper 0.9.76)
# plug-ins: Stepper, DesignLogger, Radical

# Click to true to start recording -->
number_2 = Slider(2.1, range=0..10)
number_0 = Slider(3.3, range=0..10)
number_1 = Slider(3.4, range=0..10)
expression = Expression(x=number_1, y=number_2, Expression="x*y+x*y+x*x+y*y")
expression_2 = Expression(x=number_0, y=number_1, z=number_2, Expression="x+y-z*x+y*z")
# Click to write file -->
panel = Panel("C:\Temp\")
favorite = Button()
record = BooleanToggle(False)
write = Button()
stepper = Stepper(Objective=expression_2, NumericalVariables=[number_0, number_1, number_2])  # -> ObjectiveEvolution, Var, GradientEvolution
radical = Radical(Objective=expression_2, Constraints=expression, NumericalVariables=[number_0, number_1, number_2])  # -> ObjectiveEvolution, Var, GradientEvolution
dlogger = DesignLogger(
    Record=record,
    Variables=[number_0, number_1, number_2],
    Objectives=expression_2,
    Favorite=favorite,
    Write=write,
    Directory=panel)  # -> Favorites, VarHist, ObjectiveHistory, ElapsedTime, TotalTime
panel_2 = Panel(dlogger.Favorites)
galapagos = Galapagos(fitness=expression_2, gene=[number_1, number_0, number_2])
variables = Panel(dlogger.VarHist)
objectives = Panel(dlogger.ObjectiveHistory)
time = Panel(dlogger.ElapsedTime)
