# Grasshopper definition tilde-test-multiple.gh (Grasshopper 0.9.76)
# plug-ins: Capture, Tilde, Sampler

number_slider = Slider(5.846, range=0..10)
number_slider_2 = Slider(5.688, range=0..10)
number_slider_3 = Slider(0.276, range=0..10)
number_slider_4 = Slider(3.101, range=0..10)
number_slider_5 = Slider(9.784, range=0..10)
number_slider_6 = Slider(5.738, range=0..10)
sampler = Sampler(
    Variables=[number_slider, number_slider_4, number_slider_5, number_slider_2, number_slider_6, number_slider_3],
    Samples=Slider(100, range=0..100),
    Type=0,
    Seed=Slider(1, range=0..1),
    Directory="None")  # -> DesignMap, Data
expression = Expression(x=number_slider, y=number_slider_4, z=number_slider_5, Expression="x+y-z")
ma = MassAddition(Input=[number_slider, number_slider_4, number_slider_5, number_slider_2, number_slider_6, number_slider_3])  # -> Result, PartialResults
number = Number([number_slider, number_slider_4, number_slider_5, number_slider_2, number_slider_6, number_slider_3])
capture = Capture(
    Variables=[number_slider, number_slider_4, number_slider_5, number_slider_2, number_slider_6, number_slider_3],
    Objectives=[ma.Result, expression],
    Mode=0,
    Properties=0,
    DesignMap=sampler.DesignMap,
    CsvDirectory="C:\temp",
    ScreenshotDirectory="None",
    BackupFrequency=0)  # -> DesignMapObjectives, CapturedProperties, Data, Images, Index
number_slider_7 = Slider(6, range=0..10)
split = SplitList(List=capture.DesignMapObjectives, Index=number_slider_7)  # -> ListA, ListB
split_2 = SplitList(List=split.ListB, Index=1)  # -> ListA, ListB
path_mapper = PathMapper(split_2.ListA, source="{path_index; 0 ; 0}", target="{path_index; 0}")
path_mapper_2 = PathMapper(split_2.ListB, source="{path_index; 0 ; 0}", target="{path_index; 0}")
merge = Merge(Data1=split.ListA, Data2=path_mapper_2)
merge_2 = Merge(Data1=split.ListA, Data2=path_mapper)
button = Button()
tilde = Tilde(
    DesignMapObjectives=merge_2,
    NumberOfVariables=number_slider_7,
    TrainingValidationRatio=0.5,
    Variables=number,
    Build=button)  # -> Prediction, ModelType, NuisanceParameter, TestModels, TestModelParameters, TestModelErrors
tilde_2 = Tilde(
    DesignMapObjectives=merge,
    NumberOfVariables=number_slider_7,
    TrainingValidationRatio=0.5,
    Variables=number,
    Build=button)  # -> Prediction, ModelType, NuisanceParameter, TestModels, TestModelParameters, TestModelErrors
obj_2_approx = Panel(tilde_2.Prediction)
obj_1_approx = Panel(tilde.Prediction)
obj_2_actual = Panel(expression)
obj_1_actual = Panel(ma.Result)
