# Grasshopper definition 7_bar_truss_example_tilde.gh (Grasshopper 0.9.76)
# plug-ins: Capture, Writer, MOO, Sift, Tilde, Sampler

# ----
# Variables
height = Slider(-9.452, range=-10..10)
width = Slider(1.807, range=0..5)

# ----
# Geometry
panel = Panel("10")
neg = Negative(Value=width)
pt = ConstructPoint(XCoordinate=0, YCoordinate=0, ZCoordinate=0)
pt_2 = ConstructPoint(XCoordinate=panel, YCoordinate=0, ZCoordinate=0)
vec = VectorXYZ(XComponent=width, YComponent=height, ZComponent=0)  # -> Vector, Length
vec_2 = VectorXYZ(XComponent=neg, YComponent=height, ZComponent=0)  # -> Vector, Length
division = Division(A=panel, B=2)
pt_3 = ConstructPoint(XCoordinate=division, YCoordinate=0, ZCoordinate=0)
move = Move(Geometry=pt_3, Motion=vec_2.Vector)  # -> Geometry, Transform
move_2 = Move(Geometry=pt_3, Motion=vec.Vector)  # -> Geometry, Transform
ln = Line(StartPoint=pt_2, EndPoint=move_2.Geometry)
ln_2 = Line(StartPoint=move_2.Geometry, EndPoint=move.Geometry)
ln_3 = Line(StartPoint=pt_3, EndPoint=move.Geometry)
ln_4 = Line(StartPoint=pt_3, EndPoint=move_2.Geometry)
ln_5 = Line(StartPoint=pt_2, EndPoint=pt_3)
ln_6 = Line(StartPoint=move.Geometry, EndPoint=pt)
ln_7 = Line(StartPoint=pt, EndPoint=pt_3)

pipe = Pipe(Curve=[ln_3, ln_4, ln_5, ln_6, ln_7, ln_2, ln], Radius=0.25, Caps=0)
abs = Absolute(Value=height)

# ----
# Evaluations
boundary = BoundarySurfaces(Edges=[ln_5, ln_6, ln_7, ln_2, ln])
area = Area(Geometry=boundary)  # -> Area, Centroid
neg_2 = Negative(Value=abs)

# ----
# Properties
len = Length(Curve=[ln_3, ln_4, ln_5, ln_6, ln_7, ln_2, ln])
ma = MassAddition(Input=len)  # -> Result, PartialResults
length_of_all_members = Number(ma.Result)

# ----
# Objectives
depth_negative_for_opt = Number(neg_2)
profile_area = Number(area.Area)

# ----
# Sampler
number_slider = Slider(24, range=0..100)

sampler = Sampler(
    Variables=[height, width],
    Samples=number_slider,
    Type=0,
    Seed=Slider(1, range=0..10),
    Filename="7_bar_truss",
    Directory="C:\Temp")  # -> DesignMap, Data

panel_2 = Panel(sampler.DesignMap)

# ----
# Sift
number_slider_2 = Slider(17, range=0..100)
sift = Sift(Variables=[height, width], DesignMap=panel_2, Index=number_slider_2)
panel_3 = Panel(sift)

# ----
# Capture
panel_4 = Panel("truss_screenshot")

capture = Capture(
    Variables=[height, width],
    Objectives=[profile_area, depth_negative_for_opt],
    Mode=2,
    Properties=0,
    DesignMap=sampler.DesignMap,
    CsvFilename="truss_data",
    CsvDirectory="C:\Temp",
    ScreenshotFilename=panel_4,
    ScreenshotDirectory="C:\Temp",
    BackupFrequency=0)  # -> DesignMapObjectives, CapturedProperties, Data, Images, Index

panel_5 = Panel(capture.DesignMapObjectives)
panel_6 = Panel(capture.Index)

# ----
# MOO
number_slider_3 = Slider(4, range=0..100)

moo = MOO(
    Variables=[height, width],
    Objectives=[profile_area, depth_negative_for_opt],
    PopulationSize=Slider(10, range=0..100),
    Generations=number_slider_3,
    Seed=Slider(0, range=0..100),
    Filename="truss_MOO.csv",
    Directory="C:\temp")  # -> ParetoFront, AllSolutions

panel_7 = Panel(moo.ParetoFront)
panel_8 = Panel(moo.AllSolutions)
item = ListItem(List=panel_7, Index=2, Wrap=True)  # -> flatten(Item)
item_2 = ListItem(List=panel_7, Index=3, Wrap=True)  # -> flatten(Item)

# ----
# Writer
directory = Panel("C:\temp")
writer = Writer(Data=item)

# ----
# Tilde
number_slider_4 = Slider(2, range=0..10)
split = SplitList(List=capture.DesignMapObjectives, Index=3)  # -> ListA, ListB

tilde = Tilde(
    DesignMapObjectives=split.ListA,
    NumberOfVariables=number_slider_4,
    TrainingValidationRatio=0.5,
    Variables=[height, width],
    Build=Button())  # -> Prediction, ModelType, NuisanceParameter, TestModels, TestModelParameters, TestModelErrors

actual_value = Panel(tilde.TestModelParameters)
approx_value = Panel(tilde.Prediction)
