# Grasshopper definition MOO-test-visualize.gh (Grasshopper 0.9.76)
# plug-ins: Writer, MOO, Sift

number_slider = Slider(2.982, range=0..10)
number_slider_2 = Slider(9.653, range=0..10)
expression = Expression(x=number_slider, Expression="10-x^(1/2)")
number_of_variables = Slider(2, range=0..10)
addition = Addition(A=number_slider, B=number_slider_2)
number_slider_3 = Slider(12, range=0..100)
moo = MOO(
    Variables=[number_slider, number_slider_2],
    Objectives=[addition, expression],
    PopulationSize=Slider(20, range=0..100),
    Generations=Slider(20, range=0..100),
    Seed=Slider(0, range=0..100),
    Filename="MOO-test-1.csv",
    Directory="C:\temp\")  # -> ParetoFront, AllSolutions
split = SplitList(List=moo.AllSolutions, Index=number_of_variables)  # -> ListA, ListB
# Copy panels or
# write file to graph
# in other software
panel = Panel("pareto")
# Reconstruct Design
sift = Sift(Variables=[number_slider, number_slider_2], DesignMap=split.ListA, Index=number_slider_3)
panel_2 = Panel(moo.ParetoFront)
concat = Concatenate(FragmentA="C:\temp\", FragmentB=panel)
split_2 = SplitList(List=moo.ParetoFront, Index=number_of_variables)  # -> ListA, ListB
current_design = Panel(sift)
item = ListItem(List=panel_2, Index=2, Wrap=True)  # -> flatten(Item)
objective_1_pareto_values = Panel(item)
item_2 = ListItem(List=panel_2, Index=3, Wrap=True)  # -> flatten(Item)
objective_2_pareto_values = Panel(item_2)
writer = Writer(Data=split_2.ListB, Filepath=concat)
item_3 = ListItem(List=flatten(item), Index=number_slider_3, Wrap=True)
item_4 = ListItem(List=flatten(item_2), Index=number_slider_3, Wrap=True)
# Quick Visualization
graph = QuickGraph(item_2)
graph_2 = QuickGraph(item)
# Current Design
pt = ConstructPoint(XCoordinate=item_3, YCoordinate=item_4, ZCoordinate=0)
# Rhino Visualization
# of Objective Space
# Pareto Front Designs
pt_2 = ConstructPoint(XCoordinate=item, YCoordinate=item_2, ZCoordinate=0)
