# Grasshopper definition capture-test.gh (Grasshopper 0.9.76)
# plug-ins: Capture, Sampler

number_slider = Slider(3.796, range=1..10)
number_slider_2 = Slider(3.541, range=1..10)
number_slider_3 = Slider(6.437, range=1..10)
sampler = Sampler(
    Variables=[number_slider_2, number_slider, number_slider_3],
    Samples="100",
    Type=0,
    Seed="0",
    Filename="test-01",
    Directory="C:\temp")  # -> Output, Data
panel = Panel(sampler.Output)
ma = MassAddition(Input=[number_slider_2, number_slider, number_slider_3])  # -> Result, PartialResults
capture = Capture(
    Variables=[number_slider_2, number_slider, number_slider_3],
    Objectives=ma.Result,
    Mode=0,
    Properties=0,
    DesignMap=panel,
    CsvFilename="data",
    CsvDirectory="C:\temp",
    ScreenshotFilename="screenshot",
    ScreenshotDirectory="C:\temp",
    BackupFrequency=0)  # -> DesignMapObjectives, CapturedProperties, Data, Images, Index
panel_2 = Panel(capture.Data)
panel_3 = Panel(capture.DesignMapObjectives)
panel_4 = Panel(capture.CapturedProperties)
