# Grasshopper definition effects-test.gh (Grasshopper 0.9.76)
# plug-ins: Effects

Y = Slider(3, range=0..3)
Z = Slider(0.5, range=0..1)
X = Slider(1, range=0..1)
panel = Panel("""0
0.5
1""")
expression = Expression(x=X, y=Y, z=Z, Expression="x*z-y")
ma = MassAddition(Input=[X, Y, Z])  # -> Result, PartialResults
effects = Effects(
    Variables=[X, Y, Z],
    Objectives=[ma.Result, expression],
    Levels=Slider(3, range=0..10),
    LevelSettings=panel,
    NumberOfObjectives=Slider(2, range=0..10))  # -> AverageEffects, RawEffects, DesignMapObjectives
panel_2 = Panel(effects.AverageEffects)
