# Grasshopper definition radical_num_test.gh (Grasshopper 0.9.76)
# plug-ins: Radical

number_2 = Slider(4, range=0..10)
number_1 = Slider(7.1, range=0..10)
number_0 = Slider(2.6, range=0..10)
graph = GraphMapper(
    number_2,
    x0=0,
    x1=10,
    y0=-5,
    y1=10,
    container_name="Parabola",
    Ox=0.459420234,
    Oy=0.05217397213,
    Px=0.8014492989,
    Py=0.4289855957)
graph_2 = GraphMapper(
    number_1,
    x0=0,
    x1=10,
    y0=-5,
    y1=10,
    container_name="Bezier",
    cpx=[0, 0.2391304374, 0.4275362194, 1],
    cpy=[0.2608695626, 0.8260869384, 0, 0.8478261232])
graph_3 = GraphMapper(
    number_0,
    x0=0,
    x1=10,
    y0=-5,
    y1=10,
    amplitude=0.5,
    container_name="Perlin",
    decay=0.3,
    frequency=0.1,
    x_offset=0.5,
    y_offset=0.5)
addition = Addition(A=graph_3, B=graph)
multiplication = Multiplication(A=addition, B=graph_2)
radical = Radical(Objective=multiplication, Constraints=graph_3, NumericalVariables=[number_0, number_1, number_2])  # -> ObjectiveEvolution, Var, GradientEvolution
