# Grasshopper definition 7_bar_truss_example_w_stormcloud.gh (Grasshopper 0.9.76)
# plug-ins: Capture, Writer, MOO, StormCloud, Sift, Sampler

# ----
# Variables
height = Slider(5.351, range=-10..10)
width = Slider(0.019, range=0..5)

# ----
# Geometry
panel = Panel("10")
neg = Negative(Value=width)
pt = ConstructPoint(XCoordinate=0, YCoordinate=0, ZCoordinate=0)
pt_2 = ConstructPoint(XCoordinate=panel, YCoordinate=0, ZCoordinate=0)
vec = VectorXYZ(XComponent=width, YComponent=height, ZComponent=0)  # -> Vector, Length
vec_2 = VectorXYZ(XComponent=neg, YComponent=height, ZComponent=0)  # -> Vector, Length
division = Division(A=panel, B=2)
pt_3 = ConstructPoint(XCoordinate=division, YCoordinate=0, ZCoordinate=0)
move = Move(Geometry=pt_3, Motion=vec_2.Vector)  # -> Geometry, Transform
move_2 = Move(Geometry=pt_3, Motion=vec.Vector)  # -> Geometry, Transform
ln = Line(StartPoint=pt_2, EndPoint=move_2.Geometry)
ln_2 = Line(StartPoint=move_2.Geometry, EndPoint=move.Geometry)
ln_3 = Line(StartPoint=pt_3, EndPoint=move.Geometry)
ln_4 = Line(StartPoint=pt_3, EndPoint=move_2.Geometry)
ln_5 = Line(StartPoint=pt_2, EndPoint=pt_3)
ln_6 = Line(StartPoint=move.Geometry, EndPoint=pt)
ln_7 = Line(StartPoint=pt, EndPoint=pt_3)

pipe = Pipe(Curve=[ln_3, ln_4, ln_5, ln_6, ln_7, ln_2, ln], Radius=0.25, Caps=0)
abs = Absolute(Value=height)

# ----
# Evaluations
boundary = BoundarySurfaces(Edges=[ln_5, ln_6, ln_7, ln_2, ln])
area = Area(Geometry=boundary)  # -> Area, Centroid
neg_2 = Negative(Value=abs)

# ----
# Properties
len = Length(Curve=[ln_3, ln_4, ln_5, ln_6, ln_7, ln_2, ln])
ma = MassAddition(Input=len)  # -> Result, PartialResults
length_of_all_members = Number(ma.Result)

# ----
# Objectives
depth_negative_for_opt = Number(neg_2)
profile_area = Number(area.Area)

# ----
# Stormcloud
crv = Curve([ln_3, ln_4, ln_5, ln_6, ln_7, ln_2, ln])

stormcloud = StormCloud(GeometryBrepsCurvesAndLines=crv, Score=profile_area, DesignVariables=[height, width])

# ----
# Sampler
directory = Panel("C:\temp")

sampler = Sampler(
    Variables=[height, width],
    Samples=Slider(100, range=0..100),
    Type=0,
    Seed=Slider(1, range=0..10),
    Filename="7_bar_truss",
    Directory=directory)  # -> DesignMap, Data

panel_2 = Panel(sampler.DesignMap)

# ----
# Sift
number_slider = Slider(32, range=0..100)
sift = Sift(Variables=[height, width], DesignMap=panel_2, Index=number_slider)
panel_3 = Panel(sift)

# ----
# Capture
panel_4 = Panel("truss_screenshot")

capture = Capture(
    Variables=[height, width],
    Objectives=[profile_area, depth_negative_for_opt],
    Mode=0,
    Properties=length_of_all_members,
    DesignMap=panel_2,
    CsvFilename="truss_data",
    CsvDirectory=directory,
    ScreenshotFilename=panel_4,
    ScreenshotDirectory=directory,
    BackupFrequency=0)  # -> DesignMapObjectives, CapturedProperties, Data, Images, Index

panel_5 = Panel(capture.Index)
panel_6 = Panel(capture.DesignMapObjectives)

# ----
# MOO
number_slider_2 = Slider(20, range=0..100)

moo = MOO(
    Variables=[height, width],
    Objectives=[profile_area, depth_negative_for_opt],
    PopulationSize=Slider(20, range=0..100),
    Generations=number_slider_2,
    Seed=Slider(0, range=0..100),
    Filename="truss_MOO.csv",
    Directory=directory)  # -> ParetoFront, AllSolutions

panel_7 = Panel(moo.ParetoFront)
item = ListItem(List=panel_7, Index=2, Wrap=True)  # -> flatten(Item)
item_2 = ListItem(List=panel_7, Index=3, Wrap=True)  # -> flatten(Item)

# ----
# Writer
place_csv_directory_here = Panel("C:\temp")
writer = Writer(Data=item)
