# Grasshopper definition 7_bar_truss_karamba.gh (Grasshopper 0.9.76)
# plug-ins: Karamba, Capture, Effects, MOO, Sift, Sampler

# ----
# Variables
height = Slider(1.856, range=-5..5)
width = Slider(0.465, range=0..5)

# ----
# Geometry
panel = Panel("10")
neg = Negative(Value=width)
pt = ConstructPoint(XCoordinate=0, YCoordinate=0, ZCoordinate=0)
pt_2 = ConstructPoint(XCoordinate=panel, YCoordinate=0, ZCoordinate=0)
vec = VectorXYZ(XComponent=width, YComponent=height, ZComponent=0)  # -> Vector, Length
vec_2 = VectorXYZ(XComponent=neg, YComponent=height, ZComponent=0)  # -> Vector, Length
division = Division(A=panel, B=2)
pt_3 = ConstructPoint(XCoordinate=division, YCoordinate=0, ZCoordinate=0)
move = Move(Geometry=pt_3, Motion=vec_2.Vector)  # -> Geometry, Transform
move_2 = Move(Geometry=pt_3, Motion=vec.Vector)  # -> Geometry, Transform
ln = Line(StartPoint=pt_2, EndPoint=move_2.Geometry)
ln_2 = Line(StartPoint=move_2.Geometry, EndPoint=move.Geometry)
ln_3 = Line(StartPoint=pt_3, EndPoint=move.Geometry)
ln_4 = Line(StartPoint=pt_3, EndPoint=move_2.Geometry)
ln_5 = Line(StartPoint=pt_2, EndPoint=pt_3)
ln_6 = Line(StartPoint=move.Geometry, EndPoint=pt)
ln_7 = Line(StartPoint=pt, EndPoint=pt_3)

pipe = Pipe(Curve=[ln_3, ln_4, ln_5, ln_6, ln_7, ln_2, ln], Radius=0.25, Caps=0)

# ----
# Properties
len = Length(Curve=[ln_3, ln_4, ln_5, ln_6, ln_7, ln_2, ln])
ma = MassAddition(Input=len)  # -> Result, PartialResults
length_of_all_members = Number(ma.Result)

abs = Absolute(Value=height)

# ----
# Evaluations
boundary = BoundarySurfaces(Edges=[ln_5, ln_6, ln_7, ln_2, ln])
area = Area(Geometry=boundary)  # -> Area, Centroid
neg_2 = Negative(Value=abs)

neg_3 = Negative(Value=Slider(378, range=0..500))
linetobeam = LineToBeamKaramba(Line=[ln_3, ln_4, ln_5, ln_6, ln_7, ln_2, ln], New=True, Remove=True, LimitDistance_m=0.005)  # -> Points, Element, Info
support_2 = Point([move_2.Geometry, move.Geometry])
support_1 = Point(pt_3)
Y = UnitY(Factor=neg_3)
supp = SupportKaramba(PosInd=pt_2, menu=[buttons(on, on, on, on, on, off)])
supp_2 = SupportKaramba(PosInd=pt, menu=[buttons(off, on, on, off, off, off)])
modifyelem = ModifyElementKaramba(Beam=linetobeam.Element, Bending=Toggle(True), mode="Beam")
loads = LoadsKaramba(ForceVector=Y, Local=True, PosInd=support_1, LCase=0, mode="Point")
crosecrselect = CrossSectionRangeSelectorKaramba(MaximumHeight_cm=-1, MaximumWidth_cm=-1, menu=[dropdown(3), dropdown(3), dropdown(1)])
vec_3 = VectorXYZ(XComponent=Slider(4, range=0..10), YComponent=0, ZComponent=0)  # -> Vector, Length
neg_4 = Negative(Value=Slider(6, range=0..10))
pt_4 = ConstructPoint(XCoordinate=0, YCoordinate=neg_4, ZCoordinate=0)
move_3 = Move(Geometry=pt_4, Motion=vec_3.Vector)  # -> Geometry, Transform
item = ListItem(List=crosecrselect, Index=0, Wrap=True)
assemble = AssembleModelKaramba(Elem=modifyelem, Support=[supp, supp_2], Load=loads, CrossSection=item, LimitDistance_m=0.005)  # -> Model, Info, Mass_kg, CenterOfGravity
analyzethi = AnalyzeThIKaramba(Model=assemble.Model)  # -> CalculatedModel, MaximumDisplacement_m, ResultingForceOfGravity_kN, ElasticEnergy_kNm
opticrosec = OptimizeCrossSectionKaramba(
    Model=analyzethi.CalculatedModel,
    CrossSections=crosecrselect,
    MaximumUtilization=1,
    MaximumDisplacement_m=-1,
    UltimateLimitStateIterations=5,
    DisplacementIterations=5,
    NumberOfSamplePoints=3,
    ElasticDesign=True,
    GammaM0=1,
    GammaM1=1)  # -> ModelWithOptimizedCrossSections, Info, Mass_kg, MaximumDisplacement_m, ElasticEnergy_kNm

# ----
# Objectives
mass_karamba = Number(opticrosec.Mass_kg)
profile_area = Number(area.Area)

division_2 = Division(A=opticrosec.Mass_kg, B=500)
dom = ConstructDomain(DomainStart=Slider(0, range=0..100), DomainEnd=division_2)
rectangle = Rectangle(Plane=move_3.Geometry, XSize=dom, YSize=Domain(0, 0.5), Radius=0)  # -> Rectangle, Length
xy = XYPlane(Origin=pt_4)

# ----
# Maximum Deflection
panel_2 = Panel("")
multiplication = Multiplication(A=opticrosec.Mass_kg, B=12)
normalized_objectiv = Expression(x=opticrosec.Mass_kg, z=multiplication, Expression="if(x = y, 1000000000, z)")
expression = Expression(x=normalized_objectiv, Expression="Format(\"{0:0.000}\", x)")  # -> flatten(R)
expression_2 = Expression(Expression="Format(\"{0:0.00}\", x)")
dispatch = Dispatch(List=expression_2, DispatchPattern=[True, False])  # -> ListA, ListB
expression_3 = Expression(x=expression, y="Material", z=panel_2, u=dispatch.ListA, Expression="Format(\"{0:0.0}\", y & x & z & u)")
X = UnitX(Factor=1)
Z = UnitZ(Factor=-1.5)
rgb = ColourRGB(Alpha=255, Red=0, Green=0, Blue=0)
xz = XZPlane(Origin=Point(0, 0, 0))
addition = Addition(A=Z, B=X)
move_4 = Move(Geometry=xy, Motion=addition)  # -> Geometry, Transform
tag = TextTag3D(Location=move_4.Geometry, Text=expression_3, Size="0.5", Colour=rgb, Justification=7)

boundary_2 = BoundarySurfaces(Edges=rectangle.Rectangle)
modelview = ModelViewKaramba(
    Model=opticrosec.ModelWithOptimizedCrossSections,
    LoadCaseFactorsForLinearSuperposition=1,
    IndexIncrementOfVisibleLoadcase=0)  # -> Model, DeformedMesh, DeformedAxes, DeformedModel
preview = CustomPreview(Geometry=boundary_2, Shader=ColourSwatch(SwatchColor=RGB(0, 0, 0)))
beamview = BeamViewKaramba(Model=opticrosec.ModelWithOptimizedCrossSections)  # -> Model, MeshesOfRenderedBeams, DeformedBeamAxes, LegendColors, LegendTags

# ----
# Sampler
directory = Panel("C:\Temp")

sampler = Sampler(
    Variables=[height, width],
    Samples=Slider(20, range=0..100),
    Type=0,
    Seed=Slider(2, range=0..10),
    Filename="7_bar_truss",
    Directory=directory)  # -> DesignMap, Data

design_map = Panel(sampler.DesignMap)

# ----
# Sift
number_slider = Slider(10, range=0..20)

sift = Sift(Variables=[height, width], DesignMap=design_map, Index=number_slider)

design_vector = Panel(sift)

# ----
# Capture
panel_3 = Panel("truss_screenshot")

capture = Capture(
    Variables=[height, width],
    Objectives=[profile_area, mass_karamba],
    Mode=0,
    Properties=length_of_all_members,
    DesignMap=design_map,
    CsvFilename="truss_data",
    CsvDirectory=directory,
    ScreenshotFilename=panel_3,
    ScreenshotDirectory=directory,
    BackupFrequency=0)  # -> DesignMapObjectives, CapturedProperties, Data, Images, Index

properties = Panel(capture.CapturedProperties)
design_map_objs = Panel(capture.DesignMapObjectives)

# ----
# MOO
number_slider_2 = Slider(10, range=0..100)

moo = MOO(
    Variables=[height, width],
    Objectives=[profile_area, mass_karamba],
    PopulationSize=Slider(20, range=0..100),
    Generations=number_slider_2,
    Seed=Slider(0, range=0..100),
    Filename="truss_MOO.csv",
    Directory=directory)  # -> ParetoFront, AllSolutions

panel_4 = Panel(moo.ParetoFront)
panel_5 = Panel(moo.AllSolutions)
item_2 = ListItem(List=panel_4, Index=2, Wrap=True)  # -> flatten(Item)
item_3 = ListItem(List=panel_4, Index=3, Wrap=True)  # -> flatten(Item)

# ----
# Effects
panel_6 = Panel("3")
panel_7 = Panel("""0.6
0.75
0.9""")

effects = Effects(Variables=[height, width], Objectives=opticrosec.Mass_kg, Levels=panel_6, LevelSettings=panel_7, NumberOfObjectives=1)  # -> AverageEffects, RawEffects, DesignMapObjectives

calculated_effects = Panel(effects.AverageEffects)
