# Grasshopper definition contort_test.gh (Grasshopper 0.9.76)
# plug-ins: Contort

number_slider = Slider(50, range=0..100)
# Original variables
number_slider_2 = Slider(50, range=0..100)
number_slider_3 = Slider(50, range=0..100)

expression = Expression(x=number_slider_3, y=number_slider, Expression="(x*x+y*y)/50000")
# Coefficients for mapping
number_slider_4 = Slider(1, range=0..10)
addition = Addition(A=number_slider_2, B=number_slider_3)
division = Division(A=addition, B=200)
merge = Merge(Data1=division, Data2=expression, Data3=number_slider_4)
panel = Panel(merge)
panel_2 = Panel("""0.5
-.15
.25""")
entwine = Entwine(Branch00=panel_2, Branch01=panel, FlattenInputs=True)

# ----
# Design
box = CenterBox(Base=PlaneXY(0, 0, 0), X=number_slider_2, Y=number_slider_3, Z=number_slider)
contort = Contort(
    Variables=[number_slider_2, number_slider_3, number_slider],
    Coefficients=entwine,
    SyntheticSliders=[Slider(0, range=-1..1), Slider(0, range=-1..1)],
    Scale=Slider(75, range=0..100),
    CreateSliders=Button())
