# Grasshopper definition reader-test.gh (Grasshopper 0.9.76)
# plug-ins: Reader

directory_to_reader_test_data_csv = Panel("reader-test-data.csv")
separator = Panel(",")
reader = Reader(Filepath=directory_to_reader_test_data_csv, Separator=separator)
panel = Panel(reader)
number_of_vars = Number(3)
split = SplitList(List=panel, Index=number_of_vars)  # -> ListA, ListB
objectives = Panel(split.ListB)
variables = Panel(split.ListA)
