# Grasshopper definition sift-test.gh (Grasshopper 0.9.76)
# plug-ins: Sift, Sampler

number_slider = Slider(7.443, range=1..10)
number_slider_2 = Slider(4.397, range=1..10)
number_slider_3 = Slider(6.18, range=1..10)
sampler = Sampler(
    Variables=[number_slider_2, number_slider, number_slider_3],
    Samples="100",
    Type=0,
    Seed="0",
    Filename="test-01",
    Directory="None")  # -> DesignMap, Data
panel = Panel(sampler.DesignMap)
sift = Sift(Variables=[number_slider_2, number_slider, number_slider_3], DesignMap=panel, Index=Slider(46, range=0..100))
panel_2 = Panel(sift)
box = CenterBox(Base=PlaneXY(0, 0, 0), X=number_slider_2, Y=number_slider, Z=number_slider_3)
