# Grasshopper definition stepper_test.gh (Grasshopper 0.9.76)
# plug-ins: Stepper

number_0 = Slider(0.822, range=0..1)
number_2 = Slider(0.738, range=0..1)
number_1 = Slider(0.7, range=0..1)
graph = GraphMapper(number_2, x0=0, x1=1, y0=0, y1=1, container_name="Power", Gx=0.8830318451, Gy=0.4659587741, power=6.139026224)
graph_2 = GraphMapper(number_0, x0=0, x1=1, y0=0, y1=1, container_name="Parabola", Ox=0.5, Oy=0, Px=0.8371681571, Py=0.6335369349)
graph_3 = GraphMapper(
    number_1,
    x0=0,
    x1=1,
    y0=0,
    y1=1,
    amplitude=0.3,
    container_name="Perlin",
    decay=0.3,
    frequency=0.1,
    x_offset=0.5,
    y_offset=0.5)
subtraction = Subtraction(A=graph_2, B=graph_3)
mm = MassMultiplication(Input=[graph_2, graph_3, graph])  # -> Multiplication, PartialResults
ma = MassAddition(Input=[subtraction, graph])  # -> Addition, PartialResults
stepper = Stepper(Objective=[ma.Addition, mm.Multiplication], NumericalVariables=[number_0, number_1, number_2])  # -> ObjectiveEvolution, Var, GradientEvolution
