# Grasshopper definition tilde-test.gh (Grasshopper 0.9.76)
# plug-ins: Capture, Reader, Tilde, Sampler

insert_own_data_path = Panel("C:\Directory\data.csv")
number_slider = Slider(5.846, range=0..10)
number_slider_2 = Slider(5.688, range=0..10)
number_slider_3 = Slider(0.276, range=0..10)
number_slider_4 = Slider(3.001, range=0..10)
number_slider_5 = Slider(9.784, range=0..10)
number_slider_6 = Slider(5.738, range=0..10)
separator = Panel(",")
sampler = Sampler(
    Variables=[number_slider, number_slider_4, number_slider_5, number_slider_2, number_slider_6, number_slider_3],
    Samples=Slider(100, range=0..100),
    Type=0,
    Seed=Slider(1, range=0..1),
    Directory="None")  # -> DesignMap, Data
reader = Reader(Filepath=insert_own_data_path, Separator=separator)
ma = MassAddition(Input=[number_slider, number_slider_4, number_slider_5, number_slider_2, number_slider_6, number_slider_3])  # -> Result, PartialResults
actual = Panel(ma.Result)
data_to_approximate = Panel(reader)
number = Number([number_slider, number_slider_4, number_slider_5, number_slider_2, number_slider_6, number_slider_3])
capture = Capture(
    Variables=[number_slider, number_slider_4, number_slider_5, number_slider_2, number_slider_6, number_slider_3],
    Objectives=ma.Result,
    Mode=0,
    Properties=0,
    DesignMap=sampler.DesignMap,
    CsvDirectory="None",
    ScreenshotDirectory="None",
    BackupFrequency=0)  # -> DesignMapObjectives, CapturedProperties, Data, Images, Index
tilde = Tilde(
    DesignMapObjectives=data_to_approximate,
    NumberOfVariables=Slider(6, range=0..10),
    TrainingValidationRatio=0.5,
    Variables=number,
    Build=Button())  # -> Prediction, ModelType, NuisanceParameter, TestModels, TestModelParameters, TestModelErrors
# Run Sampler + Capture
# then plug this into DM+O
# if you do not have your
# own data to approximate
alternative_simple_data = Panel(capture.DesignMapObjectives)
panel = Panel(tilde.Prediction)
panel_2 = Panel(tilde.TestModels)
panel_3 = Panel(tilde.ModelType)
panel_4 = Panel(tilde.TestModelParameters)
panel_5 = Panel(tilde.NuisanceParameter)
panel_6 = Panel(tilde.TestModelErrors)
