# Grasshopper definition sampler-test.gh (Grasshopper 0.9.76)
# plug-ins: Sampler

panel = Panel("D:\CTMueller\Digital Structures\Code\gh-design-space-exploration\Sampler\bin\")
nickname = Sampler(
    Variables=[Slider(4, range=1..10), Slider(4, range=1..10), Slider(4, range=1..10)],
    Samples="100",
    Type=2,
    Seed="0",
    Prefix="test-01",
    Path=panel)
panel_2 = Panel(nickname)
