# Grasshopper definition Tilde-Test-File.gh (Grasshopper 0.9.76)
# plug-ins: Capture, TILDA, Sampler

number_slider = Slider(0.42, range=0..1)
number_slider_2 = Slider(0.237, range=0..1)
number_slider_3 = Slider(0.359, range=0..1)
multiplication = Multiplication(A=number_slider_2, B=number_slider_3)
expression = Expression(x=multiplication, y=number_slider, Expression="x^y")
panel = Panel(expression)
addition = Addition(A=number_slider_2, B=number_slider_3)
panel_2 = Panel("D:\CTMueller\Digital Structures\Code\tilda_1\bin\")
sampler = Sampler(
    Variables=[number_slider_2, number_slider_3, number_slider],
    Samples=Slider(20, range=20..50),
    Type=2,
    Seed=0,
    Filename="test",
    Directory=panel_2)
capture = Capture(
    Variables=[number_slider_2, number_slider_3, number_slider],
    Objectives=expression,
    Mode=3,
    Properties=addition,
    DesignMap=sampler,
    CsvFilename="test1",
    CsvDirectory=panel_2,
    ScreenshotFilename="test1",
    ScreenshotDirectory=panel_2)  # -> DesignMapObjectives, CapturedProperties
panel_3 = Panel(capture.DesignMapObjectives)
tilde = Tilde(
    DesignMap=panel_3,
    NumberOfVariables="3",
    TrainingValidationRatio=0.5,
    Predict=[number_slider_2, number_slider_3, number_slider])  # -> Output, ModelType, NuisanceParameter, AllModels, AllModelParams, AllModelErrors
panel_4 = Panel(tilde.ModelType)
