# Grasshopper definition Effects27-test.gh (Grasshopper 0.9.76)
# plug-ins: Effects

number_slider = Slider(0.5, range=0..1)
number_slider_2 = Slider(1.98, range=0..3)
number_slider_3 = Slider(0.66, range=0..1)
number_slider_4 = Slider(0.5, range=0..1)
number_slider_5 = Slider(1.98, range=0..3)
number_slider_6 = Slider(0.66, range=0..1)
number_slider_7 = Slider(0.5, range=0..1)
number_slider_8 = Slider(1.98, range=0..3)
number_slider_9 = Slider(0.66, range=0..1)
panel = Panel("""0.33
0.50
0.66""")
ma = MassAddition(Input=[number_slider_9, number_slider_8, number_slider_7, number_slider_6, number_slider_5, number_slider_4, number_slider_3, number_slider_2, number_slider])  # -> Result, PartialResults
effects = Effects(
    Variables=[number_slider_9, number_slider_8, number_slider_7, number_slider_6, number_slider_5, number_slider_4, number_slider_3, number_slider_2, number_slider],
    Objectives=ma.Result,
    Levels=3,
    LevelSettings=panel,
    Levels_2=1)  # -> AverageEffects, RawEffects, SampledDesigns
panel_2 = Panel("""0     0     0     0
     0     1     1     1
     0     2     2     2
     1     0     1     2
     1     1     2     0
     1     2     0     1
     2     0     2     1
     2     1     0     2
     2     2     1     0""")
mm = MassMultiplication(Input=[number_slider_9, number_slider_8, number_slider_7])  # -> Result, PartialResults
