# Grasshopper definition MOO-test_unplugged.gh (Grasshopper 0.9.76)
# plug-ins: MOO

number_slider = Slider(6.856, range=0..10)
number_slider_2 = Slider(0.931, range=0..10)
expression = Expression(x=number_slider, Expression="10-x^(1/2)")
addition = Addition(A=number_slider, B=number_slider_2)
moo = MOO(
    Variables=[number_slider, number_slider_2],
    Objectives=[addition, expression],
    PopulationSize=Slider(20, range=0..100),
    MaxEvaluations=Slider(100, range=0..100),
    Directory="C:\Code\gh-design-space-exploration\Sampler\bin\",
    Filename="MOO-test-1.csv")  # -> ParetoFront, Evaluations
panel = Panel(moo.Evaluations)
panel_2 = Panel(moo.ParetoFront)
