# Grasshopper definition capture-test.gh (Grasshopper 0.9.76)
# plug-ins: Capture, Sampler

number_slider = Slider(4.547, range=1..10)
number_slider_2 = Slider(1.736, range=1..10)
number_slider_3 = Slider(2.129, range=1..10)
sampler = Sampler(
    Variables=[number_slider_2, number_slider, number_slider_3],
    Samples="100",
    Type=0,
    Seed="0",
    Prefix="testncb-01",
    Path="C:\Code\gh-design-space-exploration\Sampler\bin\")
panel = Panel(sampler)
panel_2 = Panel("C:\Code\gh-design-space-exploration\Sampler\bin\")
neg = Negative(Value=number_slider_2)
neg_2 = Negative(Value=number_slider)
ma = MassAddition(Input=[number_slider_2, number_slider, number_slider_3])  # -> Result, PartialResults
dom = ConstructDomain(DomainStart=number_slider_2, DomainEnd=neg)
dom_2 = ConstructDomain(DomainStart=number_slider, DomainEnd=neg_2)
capture = Capture(
    Variables=[number_slider_2, number_slider, number_slider_3],
    Objectives=ma.Result,
    Mode=1,
    Properties=ma.Result,
    DesignMap=sampler,
    CsvFilename="data",
    CsvDirectory=panel_2,
    ScreenshotFilename="screenshot",
    ScreenshotDirectory=panel_2)  # -> DesignMapObjectives, CapturedProperties
rectangle = Rectangle(Plane=PlaneXY(0, 0, 0), XSize=dom, YSize=dom_2, Radius=0)  # -> Rectangle, Length
panel_3 = Panel(capture.DesignMapObjectives)
panel_4 = Panel(capture.CapturedProperties)
