# Grasshopper definition cluster-test.gh (Grasshopper 0.9.76)
# plug-ins: Cluster, MOO, Sampler

number_slider = Slider(2.999, range=2.925..3.931)
number_slider_2 = Slider(1.457, range=1.435..2.235)
number_slider_3 = Slider(1.58, range=1.55..2.143)
ma = MassAddition(Input=[number_slider_3, number_slider_2, number_slider])  # -> Result, PartialResults
moo = MOO(
    Variables=[number_slider_3, number_slider_2, number_slider],
    Objectives=ma.Result,
    PopulationSize=Slider(20, range=0..100),
    MaxEvaluations=Slider(200, range=0..1000),
    Seed=Slider(1, range=0..1),
    Filename="test-01.csv",
    Directory="C:\Code\Directory")  # -> ParetoFront, AllSolutions
sampler = Sampler(Variables=[number_slider_3, number_slider_2, number_slider], Samples="100", Type=0, Seed="0", Directory="None")  # -> DesignMap, Data
panel = Panel(sampler.DesignMap)
sampler_data = Data(panel)
moo_data = Data(moo.AllSolutions)
rectangle = Rectangle(Plane=PlaneXY(0, 0, 0), XSize=number_slider_3, YSize=number_slider_2, Radius=0)  # -> Rectangle, Length
boxrec = BoxRectangle(Rectangle=rectangle.Rectangle, Height=number_slider)
cluster = Cluster(
    Variables=[number_slider_3, number_slider_2, number_slider],
    DesignMap=moo_data,
    NumberOfClusters=Slider(3, range=0..10),
    Flexibility=Slider(0.249, range=0..1),
    ClusterIndex=Slider(0, range=0..3))  # -> ClusterList, ClusterAvs, ClusterMins, ClusterMaxs, ClusterObjs
panel_2 = Panel(cluster.ClusterList)
panel_3 = Panel(cluster.ClusterObjs)
