# Grasshopper definition diversity-test-sort.gh (Grasshopper 0.9.76)
# plug-ins: Sampler, Diversity

sampler = Sampler(Variables=[Slider(4, range=1..10), Slider(4, range=1..10)], Samples="10", Type=0, Seed="3", Directory="None")  # -> DesignMap, Data
item = ListItem(List=sampler.DesignMap, Index=Slider(1, range=0..1), Wrap=True)
item_2 = ListItem(List=sampler.DesignMap, Index=0, Wrap=True)
panel = Panel(sampler.DesignMap)
addition = Addition(A=item_2, B=item)
panel_2 = Panel(addition)
item_3 = ListItem(List=panel, Index=1, Wrap=True)
panel_3 = Panel(item_3)
button = Button()
diversity = Diversity(
    DesignMap=panel,
    Mode=3,
    ObjectiveScores=addition,
    ObjectiveTargets=Slider(11, range=0..100),
    ObjectiveThreshold=Slider(0.19, range=0..1),
    CullTo=Slider(10, range=0..10))  # -> Diversity, Test, CulledSet, FullSet
panel_4 = Panel(diversity.FullSet)
