# Grasshopper definition diversity-test.gh (Grasshopper 0.9.76)
# plug-ins: Kangaroo Components, Sampler, Diversity, embryoA

sampler = Sampler(Variables=[Slider(4, range=1..10), Slider(4, range=1..10)], Samples="1000", Type=0, Seed="3", Directory="None")  # -> DesignMap, Data
item = ListItem(List=sampler.DesignMap, Index=Slider(1, range=0..1), Wrap=True)
item_2 = ListItem(List=sampler.DesignMap, Index=0, Wrap=True)
panel = Panel(sampler.DesignMap)
addition = Addition(A=item_2, B=item)
panel_2 = Panel(addition)
item_3 = ListItem(List=panel, Index=1, Wrap=True)
panel_3 = Panel(item_3)
button = Button()
flip = FlipMatrix(Data=sampler.DesignMap)
button_2 = Button()
bang = ExplodeTree(Data=flip)  # -> Branch0, Branch1
diversity = Diversity(
    DesignMap=panel,
    Mode=0,
    ObjectiveScores=panel_2,
    ObjectiveTargets=Slider(11, range=0..100),
    ObjectiveThreshold=Slider(0.22, range=0..1),
    CullTo=Slider(10, range=0..10),
    Iterations=Slider(100, range=0..1000),
    Run=Toggle(True))  # -> DiversityOfAllQualified, QualifiedIndices, QualifiedSet, DiversityOfCulled, CulledIndices, CulledSet
panel_4 = Panel(diversity.DiversityOfAllQualified)
panel_5 = Panel(diversity.DiversityOfCulled)
flip_2 = FlipMatrix(Data=sampler.DesignMap)
panel_6 = Panel(diversity.QualifiedSet)
panel_7 = Panel(diversity.CulledSet)
bang_2 = ExplodeTree(Data=flip_2)  # -> Branch0, Branch1
cullpareto = CSharpScript(data=diversity.QualifiedSet)  # -> out, opt, nonopt; inputs data: tree of Double
# ---------- cullpareto: C# ----------
    DataTree<double> optimal = new DataTree<double>();
    DataTree<double> nonoptimal = new DataTree<double>();

    //data should be a tree, where each branch is equivalent to one data point, and the length of the list is equal to the number of parameters.
    for(int n = 0; n < data.BranchCount; n++) //for each node
    {
      //check it against every other node
      //we need to find one node where every parameter is superior. if not, we have pareto optimality
      bool superiornodefound = false;
      for (int i = 0; i < data.BranchCount; i++) //check node i
      {
        bool issuperior = true;
        for(int p = 0; p < data.Branch(0).Count; p++)
        {
          if(data.Branch(i)[p] > data.Branch(n)[p])
          {
            issuperior = false;
            break;
          }
        }
        if(issuperior && i != n) superiornodefound = true;
      }
      if(superiornodefound) nonoptimal.AddRange(data.Branch(n), new GH_Path(nonoptimal.BranchCount));
      else optimal.AddRange(data.Branch(n), new GH_Path(optimal.BranchCount));
    }

    //return outputs
    opt = optimal;
    nonopt = nonoptimal;

    //grasshopper-related UI
    double optimalratio = Math.Round(100.0 * optimal.BranchCount / data.BranchCount, 1);
    Component.Message = optimalratio.ToString() + "% optimal";
    Component.Description = optimalratio.ToString() + "% of solutions are Pareto optimal.";
# ---------- end cullpareto ----------
flip_3 = FlipMatrix(Data=panel_6)
flip_4 = FlipMatrix(Data=panel_7)
item_4 = ListItem(Index=0, Wrap=True)
item_5 = ListItem(List=flatten(bang_2.Branch1), Index=flatten(diversity.CulledIndices), Wrap=True)
item_6 = ListItem(List=flatten(bang_2.Branch0), Index=flatten(diversity.CulledIndices), Wrap=True)
flip_5 = FlipMatrix(Data=cullpareto.opt)
bang_3 = ExplodeTree(Data=flip_4)  # -> Branch0, Branch1
pt = ConstructPoint(XCoordinate=bang_3.Branch0, YCoordinate=bang_3.Branch1, ZCoordinate=0)
item_7 = ListItem(List=flatten(bang.Branch1), Index=flatten(diversity.QualifiedIndices), Wrap=True)
item_8 = ListItem(List=flatten(bang.Branch0), Index=flatten(diversity.QualifiedIndices), Wrap=True)
bang_4 = ExplodeTree(Data=flip_3)  # -> Branch0, Branch1
duppt = RemoveDuplicatePts(Points=pt, Tolerance=0.01)
lng = ListLength(List=duppt)
panel_8 = Panel(lng)
bang_5 = ExplodeTree(Data=flip_5)  # -> Branch0, Branch1
scatter = ScatterPlot(X=bang_4.Branch0, Y=bang_4.Branch1, R=3)
scatter_2 = ScatterPlot(X=bang_5.Branch0, Y=bang_5.Branch1, R=3)
scatter_3 = ScatterPlot(X=bang_3.Branch0, Y=bang_3.Branch1, R=3)
