# Grasshopper definition diversity-test2obj.gh (Grasshopper 0.9.76)
# plug-ins: Kangaroo Components, Sampler, Diversity, embryoA

sampler = Sampler(Variables=[Slider(4, range=1..10), Slider(4, range=1..10)], Samples="1000", Type=0, Seed="3", Directory="None")  # -> DesignMap, Data
item = ListItem(List=sampler.DesignMap, Index=Slider(1, range=0..1), Wrap=True)
item_2 = ListItem(List=sampler.DesignMap, Index=0, Wrap=True)
panel = Panel(sampler.DesignMap)
addition = Addition(A=item_2, B=item)
panel_2 = Panel(addition)
number_slider = Slider(5, range=0..10)
merge = Merge(Data1=panel_2, Data2=item_2)
item_3 = ListItem(List=panel, Index=1, Wrap=True)
panel_3 = Panel(item_3)
button = Button()
button_2 = Button()
diversity = Diversity(
    DesignMap=sampler.DesignMap,
    Mode=0,
    ObjectiveScores=addition,
    ObjectiveTargets=Slider(11, range=0..100),
    ObjectiveThreshold=Slider(0.21, range=0..1),
    CullTo=Slider(10, range=0..10),
    Iterations=Slider(100, range=0..1000),
    Run=Toggle(False))  # -> DiversityOfCulled, DiversityOfAllQualified, CulledSet, QualifiedSet
panel_4 = Panel(diversity.DiversityOfCulled)
panel_5 = Panel(diversity.DiversityOfAllQualified)
panel_6 = Panel(diversity.QualifiedSet)
panel_7 = Panel(diversity.CulledSet)
flip = FlipMatrix(Data=panel_6)
flip_2 = FlipMatrix(Data=panel_7)
item_4 = ListItem(Index=0, Wrap=True)
bang = ExplodeTree(Data=flip_2)  # -> Branch0, Branch1
pt = ConstructPoint(XCoordinate=bang.Branch0, YCoordinate=bang.Branch1, ZCoordinate=0)
bang_2 = ExplodeTree(Data=flip)  # -> Branch0, Branch1
duppt = RemoveDuplicatePts(Points=pt, Tolerance=0.01)
lng = ListLength(List=duppt)
panel_8 = Panel(lng)
scatter = ScatterPlot(X=bang_2.Branch0, Y=bang_2.Branch1, R=3)
scatter_2 = ScatterPlot(X=bang.Branch0, Y=bang.Branch1, R=3)
