# Grasshopper definition diversity_MOO_test.gh (Grasshopper 0.9.76)
# plug-ins: MOO, TT Toolbox, Diversity

number_slider = Slider(5, range=0..10)
number_slider_2 = Slider(5, range=0..10)
number_slider_3 = Slider(0.879, range=0..10)
number_slider_4 = Slider(0.073, range=0..10)
rectangle = Rectangle(Plane=PlaneXY(0, 0, 0), XSize=number_slider_2, YSize=number_slider, Radius=0)  # -> Rectangle, Length
area = Area(Geometry=rectangle.Rectangle)  # -> Area, Centroid
expression = Expression(x=number_slider_3, Expression="10-x^(1/2)")
cir = Circle(Plane=PlaneXY(0, 0, 0), Radius=number_slider_2)
addition = Addition(A=number_slider_2, B=number_slider)
addition_2 = Addition(A=number_slider_3, B=number_slider_4)
num = Number([number_slider_2, number_slider])
galaplist = GalapagosListener(Genomes=num, Reset=Toggle(False))  # -> Fitness, Iterations
galapagos = Galapagos(fitness=rectangle, gene=[number_slider_2, number_slider])
moo = MOO(
    Variables=[number_slider_3, number_slider_4],
    Objectives=[addition_2, expression],
    PopulationSize=Slider(20, range=0..100),
    MaxEvaluations=Slider(100, range=0..100),
    Seed=Slider(0, range=0..100),
    Filename="MOO-test-1.csv",
    Directory="C:\Code\gh-design-space-exploration\Sampler\bin\moo_")  # -> ParetoFront, AllSolutions
merge = Merge(Data1=galaplist.Fitness, Data2=galaplist.Iterations)
panel = Panel(merge)
flip = FlipMatrix(Data=panel)
panel_2 = Panel(flip)
rev = ReverseList(List=panel_2)
lng = ListLength(List=flatten(panel))
split = SplitList(List=rev, Index=10)  # -> ListA, ListB
division = Division(A=lng, B=2)
flip_2 = FlipMatrix(Data=split.ListA)
panel_3 = Panel(division)
panel_4 = Panel(flip_2)
item = ListItem(List=panel, Index=0, Wrap=True)
split_2 = SplitTree(Data=panel)  # -> Positive, Negative
panel_5 = Panel(item)
diversity = Diversity(DesignMap=panel_5, Mode=0)  # -> Diversity, Test
rev_2 = ReverseList(List=panel)
diversity_2 = Diversity(DesignMap=panel_4, Mode=0)  # -> Diversity, Test
panel_6 = Panel(diversity.Test)
panel_7 = Panel(diversity_2.Test)
panel_8 = Panel(rev_2)
subtraction = Subtraction(A=area.Area, B=25)
item_2 = ListItem(List=diversity_2.Test, Index=2, Wrap=True)
neg = Negative(Value=item_2)
