# Grasshopper definition radical-test-surface.gh (Grasshopper 0.9.76)
# plug-ins: Radical

slider_4 = Slider(0.2, range=0..1)
slider_3 = Slider(0, range=0..1)
slider_2 = Slider(0, range=0..1)
slider_1 = Slider(1, range=0..1)
graph = GraphMapper(
    slider_3,
    x0=0,
    x1=1,
    y0=0,
    y1=1,
    container_name="Sinc",
    Equation_X0=0.5805619955,
    Equation_X1=0.7434785366,
    Equation_Y0=0.7237856388,
    Equation_Y1=0.7391304374)
graph_2 = GraphMapper(
    slider_4,
    x0=0,
    x1=1,
    y0=0,
    y1=1,
    container_name="Sinc",
    Equation_X0=0.1579711437,
    Equation_X1=0.7434785366,
    Equation_Y0=0.3072463274,
    Equation_Y1=0.7391304374)
graph_3 = GraphMapper(
    slider_2,
    x0=0,
    x1=1,
    y0=0,
    y1=1,
    container_name="Sinc",
    Equation_X0=0.2681159377,
    Equation_X1=0.7434785366,
    Equation_Y0=0.4202898741,
    Equation_Y1=0.7391304374)
graph_4 = GraphMapper(
    slider_1,
    x0=0,
    x1=1,
    y0=0,
    y1=1,
    container_name="Sinc",
    Equation_X0=0.4273509085,
    Equation_X1=0.7608699799,
    Equation_Y0=0.9422633648,
    Equation_Y1=0.5778981447)
srf = Surface(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)
mm = MassMultiplication(Input=[graph_2, graph, graph_3, graph_4])  # -> Result, PartialResults
ma = MassAddition(Input=[graph_2, graph, graph_3, graph_4])  # -> Result, PartialResults
area = Area(Geometry=srf)  # -> Area, Centroid
dsopt = DSOptimizer(
    Objective=[area.Area, mm.Result],
    Constraints=mm.Result,
    NumericalVariables=[slider_4, slider_3, slider_2, slider_1],
    SrfVar=srf)  # -> ObjectiveEvolution, Var, GradientEvolution
