# Grasshopper definition reader-test.gh (Grasshopper 0.9.76)
# plug-ins: Reader

panel = Panel("C:\Code\gh-design-space-exploration\_TestFiles\reader-test-data.csv")
nickname = Reader(Filepath=panel, Separator=",")
panel_2 = Panel(nickname)
number_of_vars = Number(3)
split = SplitList(List=panel_2, Index=number_of_vars)  # -> ListA, ListB
objectives = Panel(split.ListB)
variables = Panel(split.ListA)
