# Grasshopper definition sampler-test.gh (Grasshopper 0.9.76)
# plug-ins: Sampler

sampler = Sampler(
    Variables=[Slider(4, range=1..10), Slider(4, range=1..10), Slider(4, range=1..10)],
    Samples="100",
    Type=0,
    Seed="0",
    Filename="test-01",
    Directory="C:\Code\gh-design-space-exploration\bin")  # -> DesignMap, Data
panel = Panel(sampler.Data)
panel_2 = Panel(sampler.DesignMap)
