# Grasshopper definition stepper-test.gh (Grasshopper 0.9.76)
# plug-ins: Stepper

number_slider = Slider(6.842, range=0..10)
number_slider_2 = Slider(0.596, range=0..10)
number_slider_3 = Slider(1.439, range=0..10)
num = Number()
ma = MassAddition(Input=[number_slider, number_slider_2, number_slider_3])  # -> Result, PartialResults
multiplication = Multiplication(A=ma.Result, B=Slider(1, range=1..100))
stepper = Stepper(
    Variables=[number_slider, number_slider_2, number_slider_3],
    Objectives=multiplication,
    WhichObjective=0,
    StepSize=0.05,
    Direction=1,
    Step=False)  # -> TestedDesignMap, Gradient, B2, IsoperformanceDirection
panel = Panel(stepper.TestedDesignMap)
panel_2 = Panel(stepper.Gradient)
