# Grasshopper definition stepper-test_complicated_function.gh (Grasshopper 0.9.76)
# plug-ins: Stepper

number_slider = Slider(7.287, range=0..10)
number_slider_2 = Slider(5.063, range=0..10)
number_slider_3 = Slider(6.281, range=0..10)
number_slider_4 = Slider(6.281, range=0..10)
number_slider_5 = Slider(7.322, range=0..10)
number_slider_6 = Slider(0.104, range=0..10)
expression = Expression(
    x=number_slider_3,
    y=number_slider_4,
    z=number_slider_5,
    u=number_slider,
    v=number_slider_6,
    w=number_slider_2,
    Expression="(x+y)*2*z*u/v+w")
toggle = BooleanToggle(False)
button = Button()
ma = MassAddition(Input=[number_slider_3, number_slider_4, number_slider_5])  # -> Result, PartialResults
multiplication = Multiplication(A=ma.Result, B=2)
stepper = Stepper(
    Variables=[number_slider_3, number_slider_4, number_slider_5, number_slider, number_slider_6, number_slider_2, Slider(5, range=0..10), Slider(5, range=0..10), Slider(5, range=0..10)],
    Objectives=expression,
    WhichObjective=0,
    StepSize=0.05,
    Direction=1,
    Step=False)  # -> TestedDesignMap, Gradient, B2, IsoperformanceDirection
num = Number()
panel = Panel(stepper.TestedDesignMap)
panel_2 = Panel(stepper.Gradient)
