# Grasshopper definition GraphicStatics_Arch_Stormcloud-test.gh (Grasshopper 0.9.76)
# plug-ins: StormCloud

# ----
# Parameters
# Change these to modify the design.
number_of_walls = Slider(8, range=2..20)
vertical_factor = Slider(0, range=-1..1)
# Multiplier on total vertical load
horizontal_thrust_factor = Slider(0.349, range=0.001..2)

# ----
# Multiplier on total vertical load
total_vertical_load_kips = Slider(360, range=300..400)

# ----
# 1 unit length = 10 kips
panel = Panel("10")
# Assemble force polygon
division = Division(A=total_vertical_load_kips, B=panel)

division_2 = Division(A=division, B=number_of_walls)
xz = XZPlane(Origin=Point(0, 0, 0))
multiplication = Multiplication(A=division_2, B="-1")
pt = ConstructPoint(XCoordinate="150", YCoordinate="0", ZCoordinate=division)
rectangle = Rectangle(Plane=xz, XSize="1", YSize=multiplication, Radius=0)  # -> Rectangle, Length
xy = XYPlane(Origin=Point(0, 0, 0))
addition = Addition(A=number_of_walls, B=1)
arrrec = RectangularArray(Geometry=pt, Cell=rectangle.Rectangle, XCount="1", YCount=addition)  # -> Geometry, Transform
pt_2 = Point(Point(0, 0, 0))
pt_3 = Point(Point(90, 0, 0))
pl_origin = PlaneOrigin(Base=xy, Origin=pt)
ln = Line(StartPoint=pt_2, EndPoint=pt_3)
division_3 = Division(A="90", B=addition)
mirror = Mirror(Geometry=arrrec.Geometry, Plane=pl_origin)  # -> Geometry, Transform
pt_4 = Point(mirror.Geometry)
divide = DivideCurve(Curve=ln, Count=addition, Kinks=False)  # -> Points, Tangents, Parameters
pline = PolyLine(Vertices=pt_4, Closed=False)
pt_5 = Point(Point(150, 0, 0))
num = Number(division_3)
len = Length(Curve=pline)
len_2 = Length(Curve=pline)
multiplication_2 = Multiplication(A=len, B=horizontal_thrust_factor)
multiplication_3 = Multiplication(A=len_2, B="0.5")
X = UnitX(Factor=-1)
Z = UnitZ(Factor=vertical_factor)
subtraction = Subtraction(A=division, B=multiplication_3)
addition_2 = Addition(A=X, B=Z)
pt_6 = ConstructPoint(XCoordinate="150", YCoordinate="0", ZCoordinate=subtraction)
line = LineSDL(Start=pt_6, Direction=addition_2, Length=multiplication_2)
end = EndPoints(Curve=line)  # -> Start, End
pt_7 = Point(end.End)

ln_2 = Line(StartPoint=pt, EndPoint=pt_5)
# Force polygon lines
ln_3 = Line(StartPoint=pt_4, EndPoint=pt_7)

# ----
# Assemble form diagram
end_2 = EndPoints(Curve=ln_3)  # -> Start, End
pdecon = Deconstruct(Point=end_2.End)  # -> XComponent, YComponent, ZComponent
pdecon_2 = Deconstruct(Point=end_2.Start)  # -> XComponent, YComponent, ZComponent
subtraction_2 = Subtraction(A=pdecon_2.XComponent, B=pdecon.XComponent)
subtraction_3 = Subtraction(A=pdecon_2.ZComponent, B=pdecon.ZComponent)
division_4 = Division(A=subtraction_3, B=subtraction_2)
Z_2 = UnitZ(Factor=division_4)
X_2 = UnitX(Factor=1)
multiplication_4 = Multiplication(A=division_4, B=num)
addition_3 = Addition(A=Z_2, B=X_2)
shift = ShiftList(List=multiplication_4, Shift="-1", Wrap=False)
merge = Merge(Data1="0", Data2=shift)  # -> flatten(Result)
lng = ListLength(List=merge)
series = Series(Start=0, Step=1, Count=lng)
dom = ConstructDomain(DomainStart=0, DomainEnd=series)
subset = SubList(List=merge, Domain=dom, Wrap=True)  # -> List, Index
ma = MassAddition(Input=subset.List)  # -> flatten(Result), PartialResults
Z_3 = UnitZ(Factor=ma.Result)
eval = Evaluate(F="sqrt(x^2 + y^2)", x=num, y=multiplication_4)
shift_2 = ShiftList(List=divide.Points, Shift="-1", Wrap=False)
move = Move(Geometry=shift_2, Motion=Z_3)  # -> Geometry, Transform

# ----
# Calculate longest ray
len_3 = Length(Curve=ln_3)
sort = SortList(Keys=len_3)  # -> Keys, ValuesA
rev = ReverseList(List=sort.Keys)
item = ListItem(List=rev, Index=0, Wrap=True)  # -> flatten(Item)

# ----
# Cross sectional area:
# (8 in / 12 in) * 6 ft = 4 ft^2 = 576 in^2
# Maxmimum force in arch:
# kips
# Maxmimum stress in arch:
# kips/in^2 (ksi)
# pounds/in^2 (psi)
panel_2 = Panel("1000")
# Structural calculations
panel_3 = Panel(item)
multiplication_5 = Multiplication(A=panel_3, B="10")
panel_4 = Panel(multiplication_5)
division_5 = Division(A=panel_4, B="576")
multiplication_6 = Multiplication(A=division_5, B=panel_2)
panel_5 = Panel(multiplication_6)
num_2 = Number(panel_5)
panel_6 = Panel(division_5)
expression = Expression(x=num_2, Expression="Format(\"{0:0}\", x)")
concat = Concatenate(FragmentA="Maximum Stress: ", FragmentB=expression)
concat_2 = Concatenate(FragmentA=concat, FragmentB=" psi")
pt_8 = Point(Point(0, 0, -20))
xz_2 = XZPlane(Origin=pt_8)
panel_7 = Panel(expression)
tag = TextTag3D(Location=xz_2, Text=concat_2, Size="4", Justification=7)

# ----
# Form diagram lines
# Applied load arrows
line_2 = LineSDL(Start=move.Geometry, Direction=addition_3, Length=eval)

division_6 = Division(A=100, B=addition)
Z_4 = UnitZ(Factor=1)
neg = Negative(Value=division_6)
multiplication_7 = Multiplication(A=Z_4, B=neg)
neg_2 = Negative(Value=multiplication_7)
split = SplitList(List=move.Geometry, Index=1)  # -> ListA, ListB
move_2 = Move(Geometry=split.ListB, Motion=neg_2)  # -> Geometry, Transform
vdis = VectorDisplay(Anchor=move_2.Geometry, Vector=multiplication_7)

crv = Curve(line_2)
len_4 = Length(Curve=line_2)
multiplication_8 = Multiplication(A=len_3, B=len_4)
ma_2 = MassAddition(Input=multiplication_8)  # -> Result, PartialResults
interopt = InteractiveOptimization(GeometryBrepsCurvesAndLines=crv, Score=ma_2.Result, DesignVariables=horizontal_thrust_factor)
interopt_2 = InteractiveOptimization(GeometryBrepsCurvesAndLines=crv, Score=ma_2.Result, DesignVariables=horizontal_thrust_factor)
